vi "GetValueFromTagList.gvi"   [LabVIEW NXG 5.0.0]
inputs:
  "tag clusters": "Tag Value Cluster.gtype"[] = [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]
  "Error In": error
outputs:
  "Error Out": error
  "TagValueClusters": "TagValueCluster.gtype"[]
  "Target Names": string[]
panel indicators:
  "size(s)": i32
types:
  "DataType.gtype" = enum{"Double", "I32", "String", "Boolean", "U64", "Timestamp"}
  "Tag Value Cluster.gtype" = cluster{"Path": string, "Data Type": "DataType.gtype", "Value": string, "Time Stamp": timestamp}
  "TagValueCluster.gtype" = cluster{"Target": string, "Connected": string, "Last Communication": string, "CPU Usage": string, "RAM Usage": string, "Storage Usage": string, "Logging State": string, "System Start Time": string}
uses:
  NI::G Core::Strings::Search and Replace Pattern.gvi
diagram:
  case ($"Error In") {
    frame Error, Default {
      w1 = $"Error In"
      w2 = "TagValueCluster.gtype"[] []
      w3 = string[] []
    }
    frame No Error {
      Array Size(array=$"tag clusters") -> (size(s)=w4)
      Divide(x=w4, y=6) -> w5
      Initialize Array(element="TagValueCluster.gtype" {all zero or empty}, size=w5) -> w6
      s1 = w6  # shift register
      s2 = -1  # shift register
      for {
        w7 = each element of $"tag clusters"
        Property Node(instance in=w7) -> ("Path"=w8, "Data Type"=w9, "Value"=w10, "Time Stamp"=w11)
        case (w9) {
          frame "Double", Default {
            Floating Point String To Number(string=w10) -> (number=w13)
            w12 = default
            w14 = default
          }
          frame "String" {
            w12 = w10
            w13 = default
            w14 = default
          }
          frame "Boolean" {
            Is Equal(x=w10, y="True") -> w14
            Format Date Time String(time stamp=w11) -> (date/time string=w12)
            w13 = default
          }
          frame "I32", "U64" {
            Decimal String To Number(string=w10) -> (number=w13)
            w12 = default
            w14 = default
          }
          frame "Timestamp" {
            w12 = w10
            w13 = default
            w14 = default
          }
        }
        Array Size(array=s1) -> (size(s)=w15)
        Match Pattern(regular expression="\\.", string=w8) -> (after substring=w16, before substring=w17)
        s3 = s1  # shift register
        s4 = s2  # shift register
        for (N = w15) (iteration -> i1) {
          Array Index(array=s3) -> (out0[i1]=w18)
          Property Node(instance in=w18) -> ("Target"=w19, instance out=w20)
          Is Equal(x=w19, y=w17) -> w21
          case (w21) {
            frame False, Default {
              w22 = w20
              w23 = s4
              w24 = w12
              w25 = w13
              w26 = w14
              w27 = w16
            }
            frame True {
              case (w16) {
                frame "System.Connected" {
                  Select(s=w14, t="Connected", f="Disconnected") -> w28
                  Property Node(instance in=w20, "Connected"=w28, "Last Communication"=w12) -> (instance out=w22)
                }
                frame "System.SystemStartTime" {
                  call "Search and Replace Pattern.gvi"(string=w12, pattern="T", replace string=" ") -> (result string=w29)
                  call "Search and Replace Pattern.gvi"(string=w29, pattern="Z", replace string="") -> (result string=w30)
                  Search Or Split String(search string/char=".", string=w30) -> (substring before match=w31)
                  Property Node(instance in=w20, "System Start Time"=w31) -> (instance out=w22)
                }
                frame "System.LoggingState" {
                  Property Node(instance in=w20, "Logging State"=w12) -> (instance out=w22)
                }
                frame "Health.Memory.UsePercentage" {
                  Number To Fractional String(number=w13, precision (6)=1) -> (F-format string=w32)
                  Property Node(instance in=w20, "RAM Usage"=w32) -> (instance out=w22)
                }
                frame "Health.CPU.MeanUsePercentage" {
                  Number To Fractional String(number=w13, precision (6)=1) -> (F-format string=w33)
                  Property Node(instance in=w20, "CPU Usage"=w33) -> (instance out=w22)
                }
                frame "Health.Disk.UsePercentage" {
                  Number To Fractional String(number=w13, precision (6)=1) -> (F-format string=w34)
                  Property Node(instance in=w20, "Storage Usage"=w34) -> (instance out=w22)
                }
                frame Default {
                  w22 = w20
                }
              }
              w23 = s4
              w24 = w12
              w25 = w13
              w26 = w14
              w27 = w16
            }
          }
          Replace Array Subset(inArray=s3, index=i1, new=w22) -> w35
          next s3 = w35
          next s4 = w23
          stop if w21
        }
        case (w21) {
          frame False, Default {
            Increment(x=s4) -> w37
            Array Index(array=s3) -> (out0[w37]=w38)
            case (w27) {
              frame "System.Connected" {
                Select(s=w26, t="Connected", f="Disconnected") -> w40
                Property Node(instance in=w38, "Connected"=w40, "Last Communication"=w24, "Target"=w17) -> (instance out=w39)
              }
              frame "System.LoggingState" {
                Property Node(instance in=w38, "Logging State"=w24, "Target"=w17) -> (instance out=w39)
              }
              frame "System.SystemStartTime" {
                call "Search and Replace Pattern.gvi"(string=w24, pattern="T", replace string=" ") -> (result string=w41)
                call "Search and Replace Pattern.gvi"(string=w41, pattern="Z", replace string="") -> (result string=w42)
                Search Or Split String(search string/char=".", string=w42) -> (substring before match=w43)
                Property Node(instance in=w38, "System Start Time"=w43, "Target"=w17) -> (instance out=w39)
              }
              frame "Health.Memory.UsePercentage" {
                Number To Fractional String(number=w25, precision (6)=1) -> (F-format string=w44)
                Property Node(instance in=w38, "RAM Usage"=w44, "Target"=w17) -> (instance out=w39)
              }
              frame "Health.CPU.MeanUsePercentage" {
                Number To Fractional String(number=w25, precision (6)=1) -> (F-format string=w45)
                # #me
                Property Node(instance in=w38, "CPU Usage"=w45, "Target"=w17) -> (instance out=w39)
              }
              frame "Health.Disk.UsePercentage" {
                Number To Fractional String(number=w25, precision (6)=1) -> (F-format string=w46)
                Property Node(instance in=w38, "Storage Usage"=w46, "Target"=w17) -> (instance out=w39)
              }
              frame Default {
                w39 = w38
              }
            }
            Replace Array Subset(inArray=s3, index=w37, new=w39) -> w36
          }
          frame True {
            w36 = s3
            w37 = s4
          }
        }
        Array Size(array=w36) -> (size(s)=w47)
        $"size(s)" <- w47
        next s1 = w36
        next s2 = w37
      }
      for {
        w48 = each element of s1
        Property Node(instance in=w48) -> ("Target"=w49)
        append w49 to w3
      }
      Sort 1D Array(array=$"tag clusters")
      w1 = $"Error In"
      w2 = s1
    }
  }
  $TagValueClusters <- w2
  $"Target Names" <- w3
  $"Error Out" <- w1
